# Grasshopper definition Revit-to-Rhino_Acquire Marks.gh (Grasshopper 1.0.7)
# plug-ins: Rhino.Inside for Autodesk Revit, Human

model = ModelCategoriesPicker({"Abutments": -2006130, "Air Systems": -2001008, "Air Terminals": -2008013, "Analysis Display Style": -2000304, "Analysis Results": -2000303, "Areas": -2003200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}, selected="Duct Fittings": -2008010)
category_filter = CategoryFilter(Categories=model, Inverted=False)
category_filter_2 = CategoryFilter(Categories=model, Inverted=False)
filter_element = FilterElement(Filter=category_filter)
query_elements = QueryElements(Filter=category_filter_2)
element_geometry = ElementGeometry(DetailLevel=Slider(2, range=0..2), Elements=query_elements)  # -> simplify(Geometry)
tree_statistics = TreeStatistics(Tree=element_geometry)  # -> Paths, simplify(graft(Length)), Count
element_category = ElementCategory()  # -> Element, Category
brep = Brep(element_geometry)
panel = Panel(tree_statistics.Length)
inspect_element = InspectElement(Element=query_elements)
geometry = Geometry(flatten(element_geometry))
panel_2 = Panel("""3,3,3
120,120,120
50,50,50""")
inspect_element_2 = InspectElement(Element=query_elements)  # -> LiningFreeSize, LiningLiningThickness, LiningLiningType, InsulationOverallSize, InsulationInsulationThickness, InsulationInsulationType, MechanicalFlowAdditionalFlow, MechanicalFlowReynoldsNumber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
text = Text(inspect_element_2.IdentityDataMark)
text_2 = Text(inspect_element_2.MechanicalSystemType)
panel_3 = Panel(inspect_element_2.IdentityDataMark)
create_set = CreateSet(List=text_2)  # -> Set, Map
replace_members = ReplaceMembers(Set=text_2, Find=create_set.Set, Replace=panel_2)
colour = Colour(simplify(graft(replace_members)))
panel_4 = Panel(colour)
repeat_data = RepeatData(Data=colour, Length=tree_statistics.Length)  # -> flatten(Data)
createattributes = CreateAttributes(Color=repeat_data, enableFullPath=False)
bake_geometry = BakeGeometry(Bake=Button(), Geometry=geometry, Attributes=createattributes, DeleteOldBakes=False, PreserveTrees=False)
panel_5 = Panel(text_2)
