# Grasshopper definition Rhino-to-Revit_Direct Geometry.gh (Grasshopper 1.0.7)
# plug-ins: Rhino.Inside for Autodesk Revit, Human

object_attributes = ObjectAttributes()  # -> Name, LayerName, LayerFullPath, Color, MaterialName, LinetypeName, GroupIndices, PlotWeight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
data = Data([RGB(0, 69, 0), RGB(0, 69, 0), RGB(0, 50, 0), RGB(0, 50, 0), RGB(0, 69, 0), RGB(0, 50, 0)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])
geometry = Geometry([<brep referenced from the Rhino model> x1368])
data_2 = Data([RGB(0, 69, 0), RGB(0, 69, 0), RGB(0, 50, 0), RGB(0, 50, 0), RGB(0, 69, 0), RGB(0, 50, 0)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])
geometry_2 = Geometry([<brep referenced from the Rhino model> x1368])
data_3 = Data([RGB(0, 69, 0), RGB(0, 69, 0), RGB(0, 50, 0), RGB(0, 50, 0), RGB(0, 69, 0), RGB(0, 50, 0)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])
geometry_3 = Geometry([<brep referenced from the Rhino model> x1368])
create_set = CreateSet(List=data)  # -> Set, Map
create_set_2 = CreateSet(List=data_2)  # -> Set, Map
create_set_3 = CreateSet(List=data_3)  # -> Set, Map
number_slider = Slider(2, range=0..2)
member_index = MemberIndex(Set=data, Member=create_set.Set)  # -> Index, Count
panel = Panel("Concrete, Cast-in-Place gray")
panel_2 = Panel("Steel")
member_index_2 = MemberIndex(Set=data_2, Member=create_set_2.Set)  # -> Index, Count
member_index_3 = MemberIndex(Set=data_3, Member=create_set_3.Set)  # -> Index, Count
panel_4 = Panel("Wood - Stained")
list_item = ListItem(List=geometry, Index=member_index.Index, Wrap=True)
list_item_2 = ListItem(List=geometry_2, Index=member_index_2.Index, Wrap=True)
list_item_3 = ListItem(List=geometry_3, Index=member_index_3.Index, Wrap=True)
query_materials = QueryMaterials(Name="LocationPyramid")
geometry_4 = Geometry([<brep referenced from the Rhino model> x2])
query_materials_2 = QueryMaterials(Name="Wood - Stained")
tree_branch = TreeBranch(Tree=simplify(list_item), Path=Slider(2, range=0..2), MaintainPaths=True)
list_length = ListLength(List=tree_branch)
query_materials_3 = QueryMaterials(Name="Steel")
query_materials_4 = QueryMaterials(Name="Concrete, Cast-in-Place gray")
tree_branch_2 = TreeBranch(Tree=simplify(list_item_2), Path=Slider(0, range=0..2), MaintainPaths=True)
tree_branch_3 = TreeBranch(Tree=simplify(list_item_3), Path=Slider(1, range=0..2), MaintainPaths=True)
list_length_2 = ListLength(List=tree_branch_2)
list_length_3 = ListLength(List=tree_branch_3)
panel_7 = Panel("""0
1""")
relay = Relay()
panel_8 = Panel("""0
1""")
list_length_4 = ListLength(List=geometry_4)
panel_9 = Panel("""0
1""")
panel_10 = Panel("""0
1""")
model = ModelCategoriesPicker({"Air Terminals": -2008013, "Analysis Display Style": -2000304, "Analysis Results": -2000303, "Areas": -2003200, "Bridge Abutments": -2006130, "Bridge Arches": -2006134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}, selected="Generic Models": -2000151)
stream_filter = StreamFilter(Gate=Button(), Stream1=geometry_4)
model_2 = ModelCategoriesPicker({"Air Terminals": -2008013, "Analysis Display Style": -2000304, "Analysis Results": -2000303, "Areas": -2003200, "Bridge Abutments": -2006130, "Bridge Arches": -2006134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}, selected="Structural Framing": -2001320)
stream_filter_2 = StreamFilter(Gate=Button(), Stream1=tree_branch)
model_3 = ModelCategoriesPicker({"Air Terminals": -2008013, "Analysis Display Style": -2000304, "Analysis Results": -2000303, "Areas": -2003200, "Bridge Abutments": -2006130, "Bridge Arches": -2006134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}, selected="Structural Columns": -2001330)
model_4 = ModelCategoriesPicker({"Air Terminals": -2008013, "Analysis Display Style": -2000304, "Analysis Results": -2000303, "Areas": -2003200, "Bridge Abutments": -2006130, "Bridge Arches": -2006134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}, selected="Structural Columns": -2001330)
stream_filter_3 = StreamFilter(Gate=Button(), Stream1=tree_branch_2)
stream_filter_4 = StreamFilter(Gate=Button(), Stream1=tree_branch_3)
list_item_4 = ListItem(List=tree_branch, Index=panel_8, Wrap=True)
repeat_data = RepeatData(Data=query_materials, Length=list_length_4)
repeat_data_2 = RepeatData(Data=model, Length=list_length_4)
list_item_5 = ListItem(List=tree_branch_2, Index=panel_9, Wrap=True)
list_item_6 = ListItem(List=tree_branch_3, Index=panel_10, Wrap=True)
repeat_data_3 = RepeatData(Data=query_materials_2, Length=list_length)
repeat_data_4 = RepeatData(Data=model_2, Length=list_length)
repeat_data_5 = RepeatData(Data=query_materials_3, Length=list_length_2)
repeat_data_6 = RepeatData(Data=model_3, Length=list_length_2)
repeat_data_7 = RepeatData(Data=query_materials_4, Length=list_length_3)
repeat_data_8 = RepeatData(Data=model_4, Length=list_length_3)
add_geometry_directshape = AddGeometryDirectShape(Category=graft(repeat_data_2), Geometry=graft(stream_filter), Material=graft(repeat_data))
add_geometry_directshape_2 = AddGeometryDirectShape(Category=graft(repeat_data_4), Geometry=graft(stream_filter_2), Material=graft(repeat_data_3))
add_geometry_directshape_3 = AddGeometryDirectShape(Category=graft(repeat_data_6), Geometry=graft(stream_filter_3), Material=graft(repeat_data_5))
add_geometry_directshape_4 = AddGeometryDirectShape(Category=graft(repeat_data_8), Geometry=graft(stream_filter_4), Material=graft(repeat_data_7))
